test file "Transmission_Test_Suite"

suite "10-Speed Transmission Controller"

  case "ETRS 3" [baseline]
    model TransmissionControl, mode Normal, start time 0, stop time 65
    assessment "ETRS 3.1": At any point of time, whenever DriveRangeSelector == Park & VehicleSpeed <= 0.1 is true then, with no delay, GearCommanded == 0 must be true
      GearCommanded: signal TransmissionControl/Transmission Controller, port 2
      DriveRangeSelector: signal TransmissionControl/Variant Source2, port 1
      VehicleSpeed: signal TransmissionControl/LongitudinalVehiclePlant, port 3
      Park: expression RangeSelected.Park

  case "ETRS 4" [simulation]
    model TransmissionControl, variant configuration Test
    input "ETRS_0-60Log.mat", mapped to DriverBrake, DriverThrottle, DriverGearSelection (active)
    assessment "ETRS 4": At any point of time, if VehSpd > 0.1 becomes true then, with a delay of at most 12, VehSpd > 60 must be true
      VehSpd: signal TransmissionControl/Signal Specification, port 1

suite "Neutral, Park, Drive, Reverse Logic Tests"

  case "ParkingCommandFromStill_in_r2.1r3.1r7_test1" [baseline]
    model TransmissionController, mode Normal, start time 0, stop time 30
    input "ParkingCommand_in_r2.1_test1.mat", mapped to DriverBrake, DriverThrottle, Driver Range Selection, Vehicle Speed, Engine Speed, EngPwrOutput (active)
    assessment "ParkingCommand_in_r2.1_test1": At any point of time, if abs(vehicleSpeed) < 0.1 & rangeSelected == Park becomes true then, with a delay of at most 0.1, ParkingBrakeCommand & GearCommand == 0 must be true
      ParkingBrakeCommand: signal TransmissionController/Switch3, port 1
      rangeSelected: signal TransmissionController/Driver Range Selection, port 1
      vehicleSpeed: signal TransmissionController/Vehicle Speed, port 1
      Park: expression RangeSelected.Park
      GearCommand: signal TransmissionController/Merge, port 1

  case "ParkingCommandFromReverse_in_r2.1_test1" [baseline]
    model TransmissionController, mode Normal, start time 0, stop time 30
    input "ParkingCommandFromReverse_in_r2.1_test1.mat", mapped to DriverBrake, DriverThrottle, Driver Range Selection, Vehicle Speed, Engine Speed, EngPwrOutput (active)
    assessment "Assessment1": At any point of time, whenever rangeSelected == Park & abs(vehicleSpeed) > 0.1 is true then, with a delay of at most 1, ~ParkingBrakeCommand must be true
      rangeSelected: signal TransmissionController/Driver Range Selection, port 1
      Park: expression RangeSelected.Park
      vehicleSpeed: signal TransmissionController/Vehicle Speed, port 1
      ParkingBrakeCommand: signal TransmissionController/Merge1, port 1

  case "ParkingCommandFromDrive_in_r2.1_test2" [baseline]
    model TransmissionController, start time 0, stop time 30
    input "ParkingCommandFromDrive_in_r2.1_test2.mat", mapped to DriverBrake, DriverThrottle, Driver Range Selection, Vehicle Speed, Engine Speed, EngPwrOutput (active)
    assessment "Assessment1": At any point of time, whenever rangeSelected == Park & abs(vehicleSpeed) > 0.1 is true then, with a delay of at most 1, ~ParkingBrakeCommand must be true
      rangeSelected: signal TransmissionController/Driver Range Selection, port 1
      Park: expression RangeSelected.Park
      ParkingBrakeCommand: signal TransmissionController/Merge1, port 1
      vehicleSpeed: signal TransmissionController/Vehicle Speed, port 1

  case "ParkingCommandFromReverse_in_r2.1_test3" [baseline]
    model TransmissionController, mode Normal, start time 0, stop time 30
    input "ParkingCommandFromReverse_in_r2.1_test3.mat", mapped to DriverBrake, DriverThrottle, Driver Range Selection, Vehicle Speed, Engine Speed, EngPwrOutput (active)
    assessment "Assessment1": At any point of time, whenever rangeSelected == Park & abs(vehicleSpeed) < 0.1 is true then, with a delay of at most 0.1, ParkingBrakeCommand must be true
      rangeSelected: signal TransmissionController/Driver Range Selection, port 1
      Park: expression RangeSelected.Park
      vehicleSpeed: signal TransmissionController/Vehicle Speed, port 1
      ParkingBrakeCommand: signal TransmissionController/Merge1, port 1

  case "ParkingCommandFromDrive_in_r2.1_test4" [baseline]
    model TransmissionController, start time 0, stop time 30
    input "ParkingCommandFromDrive_in_r2.1_test4.mat", mapped to DriverBrake, DriverThrottle, Driver Range Selection, Vehicle Speed, Engine Speed, EngPwrOutput (active)
    assessment "Assessment1": At any point of time, whenever rangeSelected == Park & abs(vehicleSpeed) < 0.1 is true then, with a delay of at most 0.1, ParkingBrakeCommand must be true
      rangeSelected: signal TransmissionController/Driver Range Selection, port 1
      Park: expression RangeSelected.Park
      ParkingBrakeCommand: signal TransmissionController/Merge1, port 1
      vehicleSpeed: signal TransmissionController/Vehicle Speed, port 1